# Grasshopper definition Vessels_V1.gh (Grasshopper 1.0.8)

number_slider = Slider(0, range=0..1)
vec = VectorXYZ(XComponent=0, YComponent=0, ZComponent=Slider(1, range=-100..100))  # -> Vector, Length
pt = ConstructPoint(XCoordinate=number_slider, YCoordinate=number_slider, ZCoordinate=Slider(-30, range=-100..100))
sph = Sphere(Base=PlaneXY(0, 0, 0), Radius=Slider(30, range=-100..100))
number_slider_2 = Slider(-40, range=-100..100)
number_slider_3 = Slider(40, range=-100..100)
pl = PlaneNormal(Origin=pt, ZAxis=vec.Vector)
cyl = Cylinder(Base=pl, Radius=Slider(30, range=-100..100), Length=Slider(60, range=-100..100))
pt_2 = ConstructPoint(XCoordinate=number_slider_3, YCoordinate=number_slider_3, ZCoordinate=number_slider_3)
pt_3 = ConstructPoint(XCoordinate=number_slider_2, YCoordinate=number_slider_2, ZCoordinate=number_slider_2)
cap = CapHoles(Brep=cyl)
box = Box2Pt(PointA=pt_3, PointB=pt_2, Plane=PlaneXY(0, 0, 0))
bbox = BoundingBox(Content=cap, Plane=PlaneXY(0, 0, 0))  # -> Box, Box_2
pt_4 = ConstructPoint(XCoordinate=0, YCoordinate=0, ZCoordinate=Slider(10, range=-15..15))
pt_5 = ConstructPoint(XCoordinate=0, YCoordinate=0, ZCoordinate=Slider(-10, range=-15..15))
debox = DeconstructBox(Box=bbox.Box)  # -> Plane, X, Y, Z
ellipse = Ellipse(Plane=PlaneXY(0, 0, 0), Radius1=Slider(10, range=0..15), Radius2=Slider(5, range=0..15))  # -> Ellipse, Focus1, Focus2
py3 = Python3Script(
    Splitting_Parameter=Slider(0.16, range=0..1),
    Recursion_Times=Slider(19.978, range=0..40),
    Bounding_Shape=cap,
    Shape_Box_Z=debox.Z)  # -> out, flatten(veins), flatten(arteries); inputs Recursion_Times: Int32
# ---------- py3: Python ----------
import rhinoscriptsyntax as rs
import random
import math


heart = rs.AddSphere((0,0,0), 10)
lines = []



initial_point1 = [0,0,10]
vec_1 = [0,-5,5]
vec_2 = [0,5,5]
# bounding_box = [[-50,50],[-50,50],[-50,50]]

veins = [rs.AddLine([0,0,10], [5,0,15])]
arteries = [rs.AddLine([0,0,10], [-5,0,15])]
z = min(Shape_Box_Z)
# def Initialize(lines):
#     for i in Recursion_Times:
#         lines.append(i, [])

# Initialize(veins)
# Initialize(arteries)

def RecGen(initial_point, final_point1, final_point2, times, end_t):
    if(times >= end_t): return lines
    pt1 = CalcVector(initial_point, final_point1, times, end_t)
    if(pt1 != initial_point): lines.append(rs.AddLine(initial_point, pt1))
    if((CalcDist(pt1, final_point1) <= 20)): 
        final_point1 = [0,0,-30]
    if((CalcDist(pt1, final_point1) <= 20) and (final_point1 == final_point2)): return lines
    if((times <= 3) or (random.random() < Splitting_Parameter)):
        pt2 = CalcVector(initial_point, final_point2, times, end_t)
        if(pt2 != initial_point): lines.append(rs.AddLine(initial_point, pt2))
        if((CalcDist(pt2, final_point2) <= 20)): 
            final_point2 = [0,0,-30]
        if((CalcDist(pt2, final_point2) <= 20) and (final_point1 == final_point2)): return lines
        RecGen(pt2, final_point2, final_point2, times+1, end_t)
    RecGen(pt1, final_point1, final_point1, times+1, end_t)

def CalcVector(ini_point, final_point, times, end_t):
    rem_dist = CalcDist(ini_point, final_point)
    diff_vec = [((final_point[0] - ini_point[0])+random.uniform(-20+times, 20-times))/(rem_dist*0.25),
    ((final_point[1] - ini_point[1])+random.uniform(-20+times, 20-times))/(rem_dist*0.25), 
    ((final_point[2] - ini_point[2])+random.uniform(-20+times, 20-times))/(rem_dist*0.25) + end_t/2/(times+1)]
    next_pt = [ini_point[0] + diff_vec[0], ini_point[1] + diff_vec[1], ini_point[2] + diff_vec[2]]
    if(CalcDist(next_pt, [0,0,0]) < 10):
        return ini_point
    else: return next_pt
    return [0,0,0]

def GetNewPoint(point, vect):
    return [point(0) + vect(0), point(1) + vect(1), point(2) + vect(2)]

def CalcDist(point1, point2):
    return math.sqrt((point1[0]-point2[0])**2 + (point2[1]-point1[1])**2 + (point1[2]-point2[2])**2)

def RecGenRandom(initial_point, final_point, times, end_t, lines, bounding_box):
    if(times >= end_t): return lines
    if(initial_point[2] - final_point[2] < 20): 
        pt1 = CalcVector(initial_point, final_point, times, end_t)
        print("Part2 running")
        loopinc = 0
        while (not(WithinShape(pt1)) and loopinc < 20): 
            pt1 = CalcVector(initial_point, final_point, times, end_t)
            loopinc+=1
        if(loopinc >= 19): return lines
        else: lines.append(rs.AddLine(initial_point, pt1))
        if(CalcDist(pt1, final_point) <= 20): return lines
    else:
        pt1 = CalcVectorRandom(initial_point, final_point, times, end_t)
        loopinc = 0
        while (not(WithinShape(pt1)) and loopinc < 20): 
            pt1 = CalcVectorRandom(initial_point, final_point, times, end_t)
            loopinc+=1
        if(loopinc >= 19): return lines
        else: lines.append(rs.AddLine(initial_point, pt1))
    if((times <= 1) or (random.random() < Splitting_Parameter)):
        if(initial_point[2] - final_point[2] < 20): 
            pt2 = CalcVector(initial_point, final_point, times, end_t)
            loopinc = 0
            while (not(WithinShape(pt2)) and loopinc < 20): 
                pt2 = CalcVector(initial_point, final_point, times, end_t)
                loopinc+=1
            if(loopinc >= 19): return lines
            else: lines.append(rs.AddLine(initial_point, pt2))
            if(CalcDist(pt2, final_point) <= 20): return lines
        else:
            pt2 = CalcVectorRandom(initial_point, final_point, times, end_t)
            loopinc = 0
            while (not(WithinShape(pt2)) and loopinc < 20): 
                pt2 = CalcVectorRandom(initial_point, final_point, times, end_t)
                loopinc+=1
            if(loopinc >= 19): return lines
            else: lines.append(rs.AddLine(initial_point, pt2))
        RecGenRandom(pt2, final_point, times+1, end_t, lines, bounding_box)
    RecGenRandom(pt1, final_point, times+1, end_t, lines, bounding_box)

def CalcVectorRandom(ini_point, z_point, times, end_t):
    rem_dist = CalcDist(ini_point, z_point)
    diff_vec = [(random.uniform(-20+times, 20-times)),
    (random.uniform(-20+times, 20-times)), 
    ((z_point[2] - ini_point[2])+random.uniform(-(z_point[2] - ini_point[2])+times, (z_point[2] - ini_point[2])-times))/(rem_dist*0.25) + end_t/2/(times+1)]
    return [ini_point[0] + diff_vec[0], ini_point[1] + diff_vec[1], ini_point[2] + diff_vec[2]]

def WithinBounds(new_pt, bounding_box):
    if(CalcDist(new_pt, [0,0,0]) <= 10): return False
    elif(bounding_box[0][0] > new_pt[0]): return False
    elif(bounding_box[0][1] < new_pt[0]): return False
    elif(bounding_box[1][0] > new_pt[1]): return False
    elif(bounding_box[1][1] < new_pt[1]): return False
    elif(bounding_box[2][0] > new_pt[2]): return False
    elif(bounding_box[2][1] < new_pt[2]): return False
    else: return True
    
def WithinShape(new_pt):
    print(new_pt)
    print(rs.IsPointInSurface(Bounding_Shape, new_pt))
    if(CalcDist(new_pt, [0,0,0]) <= 10): return False
    elif(not(rs.IsPointInSurface(Bounding_Shape, new_pt))): return False
    else: return True

def WithinSphere(pt):
    if (CalcDist(pt, [0,0,0]) <= 10): return False
    elif (CalcDist(pt, [0,0,0]) >= 40): return False
    else: return True

RecGen(initial_point1, [20,20,-20], [-20,-20,-20], 0, Recursion_Times)
RecGenRandom([5,0,15], [0,0,z], 0, Recursion_Times, veins, [[0,40],[-40,40],[-40,40]])
RecGenRandom([-5,0,15], [0,0,z], 0, Recursion_Times, arteries, [[-40,0],[-40,40],[-40,40]])
# ---------- end py3 ----------
number_slider_4 = Slider(1, range=0..2)
number_slider_5 = Slider(19, range=0..30)
ellipse_2 = Ellipse(Plane=pt_4, Radius1=Slider(5, range=0..15), Radius2=Slider(2.5, range=0..15))  # -> Ellipse, Focus1, Focus2
ellipse_3 = Ellipse(Plane=pt_5, Radius1=Slider(5, range=0..15), Radius2=Slider(2.5, range=0..15))  # -> Ellipse, Focus1, Focus2
merge = Merge(Data1=ellipse_2.Ellipse, Data2=ellipse.Ellipse, Data3=ellipse_3.Ellipse)
mp = MultiPipe(
    Curves=py3.arteries,
    NodeSize=Slider(1, range=0..3),
    EndOffset=1,
    StrutSize=1,
    Segment=0,
    KinkAngle=0.6,
    CubeFit=0,
    Caps=number_slider_4)
mp_2 = MultiPipe(
    Curves=py3.veins,
    NodeSize=Slider(0.5, range=0..1),
    EndOffset=1,
    StrutSize=1,
    Segment=0,
    KinkAngle=0.6,
    CubeFit=0,
    Caps=number_slider_4)
loft = Loft(Curves=merge, Options={Adjust=False, Closed=False, LoftEnds=0, LoftSimp=0, LoftType=0, Rebuild=10, Refit=0.01})
pt_6 = ConstructPoint(XCoordinate=0, YCoordinate=0, ZCoordinate=0)
pt_7 = ConstructPoint(XCoordinate=0, YCoordinate=Slider(0.25, range=0..1), ZCoordinate=0)
capex = CapHolesEx(Brep=loft)  # -> Brep, Caps, Solid
ln = Line(StartPoint=pt_6, EndPoint=pt_7)
merge_2 = Merge(Data1=mp_2, Data2=capex.Brep, Data4=mp)  # -> flatten(Result)
rotax = RotateAxis(Geometry=merge_2, Angle=Slider(1.571, range=0..100), Axis=ln)  # -> Geometry, Transform
bbox_2 = BoundingBox(Content=merge_2, Plane=PlaneXY(0, 0, 0), UnionBox=True)  # -> Box, Box_2
debox_2 = DeconstructBox(Box=bbox_2.Box)  # -> Plane, X, Y, Z
dedomain = DeconstructDomain(Domain=debox_2.Z)  # -> Start, End
series = Series(Start=dedomain.Start, Step=Slider(3.175, range=0..5), Count=number_slider_5)
pt_8 = ConstructPoint(XCoordinate=0, YCoordinate=0, ZCoordinate=series)
planesrf = PlaneSurface(Plane=pt_8, XSize=debox_2.X, YSize=debox_2.Y)
mjoin = MeshJoin(Meshes=merge_2)
sec = MeshPlane(Mesh=bbox_2.Box, Plane=planesrf)
sec_2 = MeshPlane(Mesh=capex.Brep, Plane=planesrf)
sec_3 = MeshPlane(Mesh=mjoin, Plane=planesrf)  # -> simplify(Curves)
series_2 = Series(Start=0, Step=Slider(90, range=0..100), Count=number_slider_5)
vec_2 = VectorXYZ(XComponent=series_2, YComponent=0, ZComponent=0)  # -> Vector, Length
movetoplane = MoveToPlane(Geometry=sec, Plane=PlaneXY(0, 0, 0), Above=True, Below=True)  # -> Geometry, Transform
movetoplane_2 = MoveToPlane(Geometry=sec_3, Plane=PlaneXY(0, 0, 0), Above=True, Below=True)  # -> Geometry, Transform
move = Move(Geometry=movetoplane.Geometry, Motion=vec_2.Vector)  # -> Geometry, Transform
move_2 = Move(Geometry=movetoplane_2.Geometry, Motion=graft(vec_2.Vector))  # -> Geometry, Transform
