# Grasshopper definition Large_2.gh (Grasshopper 1.0.8)

number_slider = Slider(0, range=0..1)
pt = ConstructPoint(XCoordinate=number_slider, YCoordinate=number_slider, ZCoordinate=number_slider)
cir = Circle(Plane=pt, Radius=Slider(13.25, range=0..100))
divide = DivideCurve(Curve=cir, Count=Slider(9.05, range=0..20), Kinks=False)  # -> Points, Tangents, Parameters
cir_2 = Circle(Plane=divide.Points, Radius=Slider(2.721, range=0..10))
cir_3 = Circle(Plane=divide.Points, Radius=Slider(6.132, range=0..100))
runion = RegionUnion(Curves=cir_3)
panel = Panel(runion)
arrcurve = CurveArray(Count=10)  # -> Geometry, Transform
