# Grasshopper definition Large_2_Version_2.gh (Grasshopper 1.0.8)

lower_square1_dim = Slider(40, range=0..100)
circle_height = Slider(11, range=0..100)
division = Slider(2, range=0..4)
upper_square2_dim = Slider(40, range=0..100)
lower_square2_dim = Slider(40, range=0..100)
circle_radius = Slider(12.043, range=0..100)
upper_square1_dim = Slider(40, range=0..100)
division_2 = Slider(2, range=0..4)
division_3 = Division(A=lower_square2_dim, B=division)
pt = ConstructPoint(XCoordinate=division_3, YCoordinate=division_3, ZCoordinate=circle_height)
rectangle = Rectangle(Plane=PlaneXY(0, 0, 0), XSize=lower_square1_dim, YSize=lower_square1_dim, Radius=0)  # -> Rectangle, Length
rectangle_2 = Rectangle(Plane=PlaneXY(0, 0, 0), XSize=lower_square2_dim, YSize=lower_square2_dim, Radius=0)  # -> Rectangle, Length
division_4 = Division(A=upper_square2_dim, B=division_2)
cir = Circle(Plane=pt, Radius=circle_radius)
lower_square_rotation = Slider(0.785, range=0..1)
pt_2 = ConstructPoint(XCoordinate=division_3, YCoordinate=division_3, ZCoordinate=lower_square1_dim)
pt_3 = ConstructPoint(XCoordinate=division_3, YCoordinate=division_3, ZCoordinate=division)
rectangle_3 = Rectangle(Plane=PlaneXY(0, 0, 0), XSize=upper_square1_dim, YSize=upper_square1_dim, Radius=0)  # -> Rectangle, Length
rectangle_4 = Rectangle(Plane=PlaneXY(0, 0, 0), XSize=upper_square2_dim, YSize=upper_square2_dim, Radius=0)  # -> Rectangle, Length
number_slider = Slider(0, range=0..1)
total_height = Slider(20, range=0..100)
upper_square_rotation = Slider(0.785, range=0..1)
ln = Line(StartPoint=pt_3, EndPoint=pt_2)
pt_4 = ConstructPoint(XCoordinate=division_4, YCoordinate=division_4, ZCoordinate=upper_square1_dim)
pt_5 = ConstructPoint(XCoordinate=division_4, YCoordinate=division_4, ZCoordinate=division_2)
ln_2 = Line(StartPoint=pt_5, EndPoint=pt_4)
rotax = RotateAxis(Geometry=rectangle_2.Rectangle, Angle=lower_square_rotation, Axis=ln)  # -> Geometry, Transform
merge = Merge(Data1=rectangle.Rectangle, Data2=rotax.Geometry)
vec = VectorXYZ(XComponent=number_slider, YComponent=number_slider, ZComponent=total_height)  # -> Vector, Length
move = Move(Geometry=rectangle_3.Rectangle, Motion=vec.Vector)  # -> Geometry, Transform
rotax_2 = RotateAxis(Geometry=rectangle_4.Rectangle, Angle=upper_square_rotation, Axis=ln_2)  # -> Geometry, Transform
sunion = SolidUnion(Breps=merge)
vec_2 = VectorXYZ(XComponent=number_slider, YComponent=number_slider, ZComponent=total_height)  # -> Vector, Length
move_2 = Move(Geometry=rotax_2.Geometry, Motion=vec_2.Vector)  # -> Geometry, Transform
merge_2 = Merge(Data1=move.Geometry, Data2=move_2.Geometry)
sunion_2 = SolidUnion(Breps=merge_2)
merge_3 = Merge(Data2=sunion, Data3=cir, Data4=sunion_2)
twist_angle = Slider(1.571, range=0..15)
loft = Loft(Curves=merge_3, Options={Adjust=True, Closed=False, LoftEnds=0, LoftSimp=0, LoftType=0, Rebuild=10, Refit=0.01})
design_height = Slider(20, range=0..100)
number_slider_2 = Slider(0, range=0..1)
material_width = Slider(2, range=0..5)
division_5 = Division(A=design_height, B=material_width)
twist = Twist(Geometry=loft, Axis=ln, Angle=twist_angle, Infinite=False, Rigid=False)
series = Series(Start=Slider(0, range=0..1), Step=material_width, Count=division_5)
panel = Panel(division_5)
design_length_x = Slider(60, range=0..100)
pt_6 = ConstructPoint(XCoordinate=number_slider_2, YCoordinate=number_slider_2, ZCoordinate=series)
pt_7 = ConstructPoint(XCoordinate=number_slider_2, YCoordinate=number_slider_2, ZCoordinate=number_slider_2)
pl = ConstructPlane(Origin=pt_6, XAxis=Vector(1, 0, 0), YAxis=Vector(0, 1, 0))
sec = BrepPlane(Brep=twist, Plane=pl)  # -> Curves, Points
series_2 = Series(Start=design_length_x, Step=design_length_x, Count=division_5)
pl_2 = ConstructPlane(Origin=pt_7, XAxis=Vector(1, 0, 0), YAxis=Vector(0, 1, 0))
vec_3 = VectorXYZ(XComponent=series_2, YComponent=0, ZComponent=0)  # -> Vector, Length
movetoplane = MoveToPlane(Geometry=sec.Curves, Plane=pl_2, Above=True, Below=True)  # -> Geometry, Transform
move_3 = Move(Geometry=graft(movetoplane.Geometry), Motion=graft(vec_3.Vector))  # -> Geometry, Transform
number_slider_3 = Slider(1, range=0..1)
sunion_3 = SolidUnion(Breps=move_3.Geometry)
series_3 = Series(Start=number_slider_3, Step=number_slider_3, Count=division_5)
neg = Negative(Value=division_5)
debrep = DeconstructBrep(Brep=sunion_3)  # -> Faces, Edges, Vertices
fline = FitLine(Points=debrep.Vertices)
textsrf = TextOnSurface(
    Text=graft(series_3),
    Font="Sans Bold:no Italic:no",
    Height=Slider(5.787, range=0..50),
    Depth=0.4,
    BaseLine=fline,
    BaseSurface=sunion_3)
