# Grasshopper definition L3-3DPSlicerGcodeGeneratorBase.gh (Grasshopper 1.0.8)
# plug-ins: Pancake

# [TODO]: Create Test Cylinder and Move to center of Bed
number_slider = Slider(10, range=0..30)
height = Slider(1.5, range=0..10)
midpoint = Slider(105, range=0..200)
cir = Circle(Plane=PlaneXY(0, 0, 0), Radius=number_slider)
Z = UnitZ(Factor=height)
build_plate_middle = VectorXYZ(XComponent=midpoint, YComponent=midpoint, ZComponent=Slider(0.01, range=0..1))  # -> Vector, Length
extr = Extrude(Base=cir, Direction=Z)
# [TODO]: Create Contours / Perimeters)
number_slider_2 = Slider(0.3, range=0..1)
cap = CapHoles(Brep=extr)
Z_2 = UnitZ(Factor=1)
move = Move(Geometry=cap, Motion=build_plate_middle.Vector)  # -> Geometry, Transform
contour = Contour(Shape=move.Geometry, Point=Point(0, 0, 0), Direction=Z_2, Distance=number_slider_2)  # -> simplify(Contours)
# [TODO]: Create Infill Patterns
extrusion_width = Slider(0.48, range=0..5)
boundary = BoundarySurfaces(Edges=contour)  # -> simplify(Surfaces)
debox = DeconstructBox(Box=boundary)  # -> Plane, X, Y, Z
py3 = Python3Script(eWidth=extrusion_width, x=debox.X, y=debox.Y, z=debox.Z)  # -> out, simplify(lines)
# ---------- py3: Python ----------
import rhinoscriptsyntax as rs

xcur = min(x)
xmax = max(x)
ymin = min(y)
ymax = max(y)
z = min(z)

lines = []

while xcur < xmax:
    xcur += eWidth
    lines.append(rs.AddLine((xcur, ymin,z),(xcur, ymax, z)))
# ---------- end py3 ----------
# [TODO]: Combine Perimeters and Infill
panel = Panel(debox.Z)
blx = BrepLine(Brep=boundary, Line=py3.lines, LimitToFirst=False)  # -> Curves, Points
trim = TrimTree(Tree=blx.Curves, Depth=1)
merge = Merge(Data1=contour, Data2=trim)
# [TODO]: Create Line Segments from Perimeters and Infill
panel_2 = Panel(merge)
divlength = DivideLength(Curve=merge, Length=Slider(0.1, range=0..1))  # -> Points, Tangents, Parameters
pline = PolyLine(Vertices=divlength.Points, Closed=False)
simplify = SimplifyCurve(Curve=pline, Tolerance=Slider(0.01, range=0..1))  # -> Curve, Simplified
explode = Explode(Curve=simplify.Curve, Recursive=True)  # -> flatten(Segments), Vertices

# ---- group: A second line for testing
construct_point = ConstructPoint(XCoordinate=Slider(10, range=-10..30), YCoordinate=Slider(10, range=-10..30), ZCoordinate=Slider(1, range=-10..30))
construct_point_2 = ConstructPoint(XCoordinate=Slider(10, range=-10..30), YCoordinate=Slider(20, range=-10..30), ZCoordinate=Slider(1, range=-10..30))
line = Line(StartPoint=construct_point, EndPoint=construct_point_2)

# ---- group: Example of a line for testing
# [TODO]: Use lines for testing gcode generation then replace with line segments from slicing
number_slider_3 = Slider(5, range=-10..30)
construct_point_3 = ConstructPoint(XCoordinate=number_slider_3, YCoordinate=Slider(1, range=-10..30), ZCoordinate=Slider(0, range=-10..30))
construct_point_4 = ConstructPoint(XCoordinate=Slider(30, range=-10..30), YCoordinate=Slider(1, range=-10..30), ZCoordinate=Slider(0, range=-10..30))
line_2 = Line(StartPoint=construct_point_3, EndPoint=construct_point_4)

# ----
nozzle_diameter = Slider(0.4, range=0..1)
end_gcode_do_not_edit = Panel("""; ##### WARNING: DO NOT EDIT THE END GCODE! ######
; END Gcode 
M107
;TYPE:Custom
; Filament-specific end gcode
G1 Z2.4 F720 ; Move print head up
M104 S0 ; turn off temperature
M140 S0 ; turn off heatbed
M107 ; turn off fan
G1 X241 Y170 F3600 ; park
G1 Z24.4 F300 ; Move print head up
M73 P97 R0
M73 Q97 S0
G4 ; wait
M900 K0 ; reset LA
M142 S36 ; reset heatbreak target temp
M84 X Y E ; disable motors
M73 P100 R0
M73 Q100 S0""")
start_gcode_do_not_edit = Panel(""";#### WARNING: DO NOT EDIT THE START GCODE! #####
;START GCODE
M73 P0 R2
M73 Q0 S2
M201 X2500 Y2500 Z200 E2500 ; sets maximum accelerations, mm/sec^2
M203 X200 Y200 Z40 E100 ; sets maximum feedrates, mm / sec
M204 P2000 R1200 T2000 ; sets acceleration (P, T) and retract acceleration (R), mm/sec^2
M205 X8.00 Y8.00 Z2.00 E10.00 ; sets the jerk limits, mm/sec
M205 S0 T0 ; sets the minimum extruding and travel feed rate, mm/sec

M486 S0
M486 custom-gcode.stl
M486 S-1

;TYPE:Custom v20251022a
M17 ; enable steppers
M862.3 P "MK4" ; printer model check
M862.1 P0.4 A0 F0 ; nozzle check
M115 U6.1.3+7898
M555 X115 Y91 W32 H24

G90 ; use absolute coordinates
M83 ; extruder relative mode

M140 S60 ; set bed temp
M104 T0 S170 ; set extruder temp for bed leveling
M109 T0 R170 ; wait for temp

M84 E ; turn off E motor
G28 ; home all without mesh bed level
G1 X42 Y-4 Z5 F4800
M302 S160 ; lower cold extrusion limit to 160C
G1 E-2 F2400 ; retraction
M84 E ; turn off E motor
G29 P9 X10 Y-4 W32 H4
M106 S100
G0 Z40 F10000
M190 S60 ; wait for bed temp
M107
;
; MBL
;
M84 E ; turn off E motor
G29 P1 ; invalidate mbl & probe print area
G29 P1 X0 Y0 W50 H20 C ; probe near purge place
G29 P3.2 ; interpolate mbl probes
G29 P3.13 ; extrapolate mbl outside probe area
G29 A ; activate mbl

; prepare for purge
M104 S215
G0 X0 Y-4 Z15 F4800 ; move away and ready for the purge
M73 P1 R2
M73 Q1 S2
M109 S215

G92 E0
M569 S0 E ; set spreadcycle mode for extruder
;
; Extrude purge line
;
G92 E0 ; reset extruder position
G1 E2 F2400 ; deretraction after the initial one before nozzle cleaning
G0 E7 X15 Z0.2 F500 ; purge
G0 X25 E4 F500 ; purge
M73 P3 R2
M73 Q3 S2
G0 X35 E4 F650 ; purge
M73 P4 R2
M73 Q4 S2
G0 X45 E4 F800 ; purge
G0 X48 Z0.05 F8000 ; wipe, move close to the bed
M73 P5 R2
M73 Q5 S2
G0 X51 Z0.2 F8000 ; wipe, move quickly away from the bed

G92 E0
M221 S100 ; set flow to 100%
G21 ; set units to millimeters
G90 ; use absolute coordinates
M83 ; use relative distances for extrusion
M900 K0.05 ; Filament gcode

M142 S36 ; set heatbreak target temp
M107""")
travel_feed_rate = Panel("1200")
# [TODO]: Initialize Input Parameters
line_3 = Line([line_2, line])
# NOTE THAT THIS GCODE OUTPUT ASSUMES:
# - A PRUSA MK4 as the Printer
# - PLA Material
# - Extrusion Temperature: 215C
# - Heated Bed Temperature: 60C
multiplication = Multiplication(A=nozzle_diameter, B=Slider(1.2, range=0..2))
# [TODO]: Implement the gcode generation algorithm in Python
python_3_script_generate_gcode = Python3Script(
    lines=flatten(explode.Segments),
    nozzle_diameter=nozzle_diameter,
    filament_diameter=Slider(1.75, range=0..2),
    layer_height=Slider(0.3, range=0..1),
    extrusion_width=multiplication,
    travel_feed_rate=travel_feed_rate,
    layer_change_feed_rate=Slider(720, range=0..1000),
    extrusion_feed_rate=Slider(600, range=0..1000),
    start_gcode_lines=start_gcode_do_not_edit,
    end_gcode_lines=end_gcode_do_not_edit)  # -> out, gcode_output; inputs lines: list of Line, nozzle_diameter: Double, filament_diameter: Double, layer_height: Double, extrusion_width: Double, travel_feed_rate: Double, layer_change_feed_rate: Double, extrusion_feed_rate: Double, start_gcode_lines: list of String, end_gcode_lines: list of String
# ---------- python_3_script_generate_gcode: Python ----------
"""
    This file contains parameters, helpers, and setup to 
    create a basic gcode generation algorithm from line segments.
    
    The main 
    
    Inputs:
        lines: the line segments to be converted into gcode commands for extrusion 
        nozzle_diameter: the diameter of the 3D printer's nozzle
        filament_diameter: the diameter of the 3d printing filament
        layer_height: the height of each layer in the print
        extrusion_width: the width of the extruded line from the printer
        travel_feed_rate: the speed at which the extruder moves in X and Y
        layer_change_feed_rate: the speed at which teh extruder moves when 
            changing layers in the Z direction
        extrusion_feed_rate: the speed at which the extruder move when extruding

    Output:
        gcode_output: a string with gcode commands separate by new-lines"""

__author__ = "mrivera-cu"

import rhinoscriptsyntax as rs

import math


########## CONSTANTS BELOW ###############

# GCODE COMMANDS
COMMAND_MOVE = "G1"

# GCODE PARAM NAMES
PARAM_X = "X"
PARAM_Y = "Y"
PARAM_Z = "Z"
PARAM_E = "E"
PARAM_F = "F"

# Separates commands
COMMAND_DELIMITER = "\n"

# Precision for converting floats to strings
E_VALUE_PRECISION = 5
XYZ_VALUE_PRECISION = 3

# Float equality precision
FLOAT_EQUALITY_PRECISION = 5

# Converts a float (f) to a string with some precision of decimal places
# For example: 
# Input: f=0.1234, precision=3 
# Output: "0.123"
def float_to_string(f, precision=XYZ_VALUE_PRECISION): 
    f = float(f)
    str_format = "{value:." + str(precision) +"f}"
    return str_format.format(value=f)
    
# Helper to convert the E value to the proper precision
def e_value_to_string(e):
    return float_to_string(e, E_VALUE_PRECISION)

# Helper to convert the XYZ value to the proper precision
def xyz_value_to_string(e):
    return float_to_string(e, XYZ_VALUE_PRECISION)

#########################################################################

# Helper function to compare floats in grasshopper/python due to float precision errors
def are_floats_equal(f1, f2, epsilon=10**(-FLOAT_EQUALITY_PRECISION)):
    f1 *= 10**FLOAT_EQUALITY_PRECISION
    f2 *= 10**FLOAT_EQUALITY_PRECISION
    return math.fabs(f2 - f1) <= epsilon
    
# Helper function to compare if two points are equal (have the same coordinates)
# by handling float precision comparisons
def is_same_pt(ptA, ptB):
    return are_floats_equal(ptA[0], ptB[0]) and are_floats_equal(ptA[1], ptB[1]) and are_floats_equal(ptA[2], ptB[2])
     
     
########################################################################
# creates a string consisting of a G1 move command and 
# any associated parameters
def gcode_move(current_pos, next_pos, feed_rate=None, should_extrude=False):
    # Start with "G1" as command
    move_command_str = COMMAND_MOVE
    
    # Compare X positions
    if (not are_floats_equal(current_pos[0],next_pos[0])):
        # we have a different x position so add it as a parameter to the command
        x_value = float_to_string(next_pos[0], precision=XYZ_VALUE_PRECISION)
        # Add X<x_value> to move string, e.g., X100.00
        move_command_str += " " + PARAM_X + x_value
    
    # Compare Y positions
    if (not are_floats_equal(current_pos[1], next_pos[1])):
        # we have a different y position so add the new position as a parameter
        y_value = float_to_string(next_pos[1], precision=XYZ_VALUE_PRECISION)
        # Add Y<y_value> to move string, e.g., Y100.00
        move_command_str += " " + PARAM_Y + y_value
    
    # Compare Z position
    if (not are_floats_equal(current_pos[2], next_pos[2])):
        # we have a different z position so add the new position as a parameter
        z_value = float_to_string(next_pos[2], precision=XYZ_VALUE_PRECISION)
        # Add Z<z_value> to move string, e.g., Z100.00
        move_command_str += " " + PARAM_Z + z_value
    
    # [TODO]: handle "should_extrude" == true by determining the proper amount to
    # extrude using the capsule model, then append the E parameter and value
    # to the move command.
    # NOTE: YOUR FLOAT PRECISION MUST MATCH E_VALUE_PRECISION
    
    if(should_extrude):
        dimension = math.sqrt((next_pos[0] - current_pos[0])**2 + (next_pos[1] - current_pos[1])**2 + (next_pos[2] - current_pos[2])**2 )
        V_out = dimension * ((layer_height * (extrusion_width - layer_height)) + (math.pi*(layer_height/2)**2))
        E_value = V_out / (math.pi*(filament_diameter/2)**2)
        move_command_str += " " + PARAM_E + float_to_string(E_value, precision=E_VALUE_PRECISION)
    
    # See if we have a feedrate to use, and handle it differently than other 
    # parameters as it is an integer value
    if (feed_rate is not None):
        # feed rate is an int
        feed_rate_value = round(feed_rate)
        # Add F<feed_rate_value> to move string, e.g., F2000
        move_command_str += " " + PARAM_F + str(feed_rate_value)   
    
    # Remove excess whitespace on ends
    move_command_str = move_command_str.strip(" ")
    return move_command_str


############################################
############################################
############################################
    
''' Here's the main method of the script that uses the helper methods above '''

def generate_gcode():

    # [TODO]: Implement the algorithm to generate gcode for each layer by 
    # first to moveing to the layer height, then moving to each line segment.
    # Once at a line segment, you should move and extrude along it, 
    # then move (travel) to the next line until there are no lines left
    # For each of these movements, you should append the command to
    # the list: `all_move_commands`
    current_position = [0, 0, 0]        # start extruder at the origin
    all_move_commands = []              # list to hold for all the move commands

    for i in range(0, len(lines)):
        # Get pts of the line segment
        line = lines[i]
        line_start_position = line.From
        line_end_position = line.To
        
        # [TODO]: Handle moving to the next layer (Z Position)
        # NOTE- ALL Z MOVEMENTS SHOULD:
        # 1) BE INDEPENDENT MOVES(e.g., G1 Z# and not move with other positions like XYE) 
        # 2) USE THE `layer_change_feedrate`
        # 3) BE IN INCREASING ORDER
        if not(current_position[2]==line_start_position[2]):
            if(current_position[2]>line_start_position[2]): print("z value decreases: " + str(current_position[2]) + "," +  str(line_start_position[2]))
            move_to_line = gcode_move(current_position, (current_position[0], current_position[1], line_start_position[2]), feed_rate=layer_change_feed_rate)
            all_move_commands.append(move_to_line)
            current_position = (current_position[0], current_position[1], line_start_position[2])
        

        # Now if our current_position is not the start of our line segment
        # we need to move (travel) to the line segment's starting point
        if not is_same_pt(current_position, line_start_position):
            # [Move to the the line_start_position
            move_to_line_start_command = gcode_move(current_position, line_start_position, feed_rate=travel_feed_rate)
            # A ppend command
            all_move_commands.append(move_to_line_start_command)
        
        # [TODO]: Once our extruder is at the start of the line, create a 
        # command to move AND extrude along 
        # the line segment using `extrusion_feed_rate`
        move= gcode_move(line_start_position, line_end_position, feed_rate=extrusion_feed_rate, should_extrude = True)
        all_move_commands.append(move)

        # [TODO]: Append the move command across the line segment 

        
        # [TODO]: Update the current position of our extruder to be at the end of the line
        current_position = line_end_position
        
    # End of for-loop above -- now create the full set of commands


    # [TODO]: Once you have all of the move commands stored as a list in
    # `all_move_commands`, combine the `start_gcode_lines`, `all_move_commands`, and `end_gcode_lines`
    # into one list called `gcode_lines`   
    gcode_lines = start_gcode_lines + all_move_commands + end_gcode_lines

    # --- DO NOT EDIT BELOW ----
    # The takes the combined gcode_lines list and creates a string containing each line
    # separated by a COMMAND_DELIMITER (the new-line character), and sets it 
    # to the `gcode_output`variable of this component
    output = COMMAND_DELIMITER.join(gcode_lines)
    
    return output
    
''' RUN THE MAIN FUNCITON ABOVE - DO NOT EDIT '''
# this sets the gcode commands to be the the `gcode_output` variable of this grasshopper component
gcode_output = generate_gcode()
# ---------- end python_3_script_generate_gcode ----------
the_gcode_output = Panel(python_3_script_generate_gcode.gcode_output)
debugging_panel = Panel(python_3_script_generate_gcode.out)
# [TODO]: Use Pancake Plug-in to Export Gcode Output File as .gcode
panel_3 = Panel("C:\Vivian CU Boulder\CSCI 4830\CSCI_4830_Blog\Large_3\SHI_VIVIAN_output.gcode")
truebutton = TrueOnlyButton(LastSaveLocalization="neutral,N")
pcexporttxt = ExportTXT(
    Content=the_gcode_output,
    FileLocation=panel_3,
    Overwrite=Toggle(True),
    Encoding="default",
    Export=truebutton,
    LastSaveLocalization="neutral,N")
panel_4 = Panel(pcexporttxt)
