# Grasshopper definition 2.4.1.0 Update Notice.gh (Grasshopper 1.0.7)
# plug-ins: Pancake

# 2.4.1.0 is a minor update focused at fixing bugs
# and bringing the latest version onto Mono.
# 
# There're few improvements.
# 
# (1) You can directly use string literal with Quantity Operator.
# The output is still a Quantity, rather than text.
pcmaintainvisapp = MaintainVisualAppearance(DpiScale=1, LastSaveLocalization="neutral,N")
# (3) Parameter names of clusters can be
# automatically updated, after being changed inside the cluster,
# if you enable "Refresh Automatically" in the menu "Pancake" -> "Cluster Operations"
# (4) In the extended context menu,
# you may disconnect all inputs/outputs of a component.
# Or set styles of wires from a selection of components.
panel = Panel("{0:Fnz}")
# (2) You may use the built-in Format to
# format Quantity.
panel_2 = Panel("-")
qty = Quantity("5'4 3/8\"", LastSaveLocalization="neutral,N")
qty_2 = Quantity("0'0 3/8\"", LastSaveLocalization="neutral,N")
pcqtyop = QuantityOperator(OperandA="5mm", OperandB="3.5m", Operator="+", LastSaveLocalization="neutral,N")
pcqtyop_2 = QuantityOperator(OperandA="5'6.5\"", OperandB="13\"", Operator=panel_2, LastSaveLocalization="neutral,N")
format = Format(Format="{0:ftin@4}", Culture=127, Data0=qty)
format_2 = Format(Format="{0:Frd}", Culture=127, Data0=qty)
format_3 = Format(Format="{0}", Culture=127, Data0=qty_2)
format_4 = Format(Format="{0:mm/0.0}", Culture=127, Data0=qty)
format_5 = Format(Format="{0}", Culture=127, Data0=qty)
format_6 = Format(Format=panel, Culture=127, Data0=qty_2)
# <- These will raise error in previous versions.
panel_3 = Panel(pcqtyop)
panel_4 = Panel(pcqtyop_2)
panel_5 = Panel(format)
panel_6 = Panel(format_2)
panel_7 = Panel(format_5)
panel_8 = Panel(format_3)
panel_9 = Panel(format_4)
panel_10 = Panel(format_6)
qty_3 = Quantity("123456789123456mm", LastSaveLocalization="neutral,N")
qty_4 = Quantity("12312mm", LastSaveLocalization="neutral,N")
format_7 = Format(Format="{0}", Culture=127, Data0=qty_3)
format_8 = Format(Format="{0:m/N0}", Culture=127, Data0=qty_3)
format_9 = Format(Format="{0:ftin@32/Frd}", Culture=127, Data0=qty_4)
panel_11 = Panel(format_7)
panel_12 = Panel(format_8)
panel_13 = Panel(format_9)
