# Grasshopper definition Task_1.gh (Grasshopper 1.0.8)

height = Slider(0.3, range=0..10)
midpoint = Slider(0, range=0..200)
cir = Circle(Plane=PlaneXY(0, 0, 0), Radius=Slider(10, range=0..30))
Z = UnitZ(Factor=height)
build_plate_middle = VectorXYZ(XComponent=midpoint, YComponent=midpoint, ZComponent=0)  # -> Vector, Length
extr = Extrude(Base=cir, Direction=Z)
cap = CapHoles(Brep=extr)
Z_2 = UnitZ(Factor=1)
move = Move(Geometry=cap, Motion=build_plate_middle.Vector)  # -> Geometry, Transform
contour = Contour(Shape=move.Geometry, Point=Point(0, 0, 0), Direction=Z_2, Distance=Slider(0.3, range=0..1))  # -> simplify(Contours)
boundary = BoundarySurfaces(Edges=contour)
extrusion_width = Slider(0.48, range=0..5)
debox = DeconstructBox(Box=boundary)  # -> Plane, X, Y, Z
py3 = Python3Script(eWidth=extrusion_width, x=debox.X, y=debox.Y, z=debox.Z)  # -> out, simplify(lines)
# ---------- py3: Python ----------
import rhinoscriptsyntax as rs

xcur = min(x)
xmax = max(x)
ymin = min(y)
ymax = max(y)
z = min(z)
lines = []

while xcur < xmax:
    xcur += eWidth
    lines.append(rs.AddLine((xcur, ymin,z),(xcur, ymax, z)))
# ---------- end py3 ----------
blx = BrepLine(Brep=boundary, Line=py3.lines, LimitToFirst=False)  # -> Curves, Points
trim = TrimTree(Tree=blx.Curves, Depth=1)
merge = Merge(Data1=trim, Data2=contour)
panel = Panel(merge)
divlength = DivideLength(Curve=merge, Length=Slider(0.1, range=0..1))  # -> Points, Tangents, Parameters
pline = PolyLine(Vertices=divlength.Points, Closed=False)
simplify = SimplifyCurve(Curve=pline, Tolerance=Slider(0.01, range=0..1))  # -> Curve, Simplified
explode = Explode(Curve=simplify.Curve, Recursive=True)  # -> flatten(Segments), Vertices
