# Grasshopper definition Task_1.gh (Grasshopper 1.0.8)

py3 = Python3Script(
    Step=Slider(7.609, range=0..20),
    RadiusMin=Slider(2, range=0..10),
    RadiusMax=Slider(2, range=0..5),
    Size=Slider(15, range=0..60),
    Height=Slider(60, range=0..60))  # -> out, points, spheres, cones, box; inputs Step: Int32
# ---------- py3: Python ----------
import rhinoscriptsyntax as rs
import random
# import RhinoGeometry as rg
import System.Drawing as sd


Step = int(Step)
points = []
spheres = []
cones = []
vertices = []
s = int(Size)
h = int(Height)

for y in range(Step + 1):
    for x in range(Step + 1):
        pt = rs.AddPoint(s/Step * x,s/ Step * y,0)
        points.append(pt)
        rand = random.random()*(RadiusMax - RadiusMin) + RadiusMin
        print(rand)
        spheres.append(rs.AddSphere(pt,rand))
        if ((x == 0 or x == Step) and (y == 0 or y == Step)):
            cones.append(rs.AddCone((s/Step * x,s/ Step * y,-h),(2*h),4))
box = rs.AddBox([(0,0,0), (s,0,0), (s,s,0), (0,s,0), (0,0,h), (s,0,h), (s,s,h), (0,s,h)])
# ---------- end py3 ----------
panel = Panel(py3.cones)
panel_2 = Panel(py3.out)
merge = Merge(Data1=py3.spheres, Data2=py3.cones)
sunion = SolidUnion(Breps=merge)
sint = SolidIntersection(BrepsA=sunion, BrepsB=py3.box)
